# Grasshopper definition Pylon -  LunchBox.gh (Grasshopper 1.0.7)
# plug-ins: LunchBox

gene_pool = GenePool(Decimals=0, Maximum=40, Minimum=0, Value=[0, 20, 40])
gene_pool_2 = GenePool(Decimals=0, Maximum=50, Minimum=0, Value=[20, 10, 25])
construct_point = ConstructPoint(XCoordinate=0, YCoordinate=0, ZCoordinate=gene_pool)
circle = Circle(Plane=construct_point, Radius=gene_pool_2)
loft = Loft(Curves=circle, Options={Adjust=False, Closed=False, LoftEnds=0, LoftSimp=0, LoftType=0, Rebuild=10, Refit=0.01})
diagrid_structure = DiagridStructure(Surface=loft, UDivisions=Slider(16, range=0..100), VDivisions=Slider(22, range=0..100), Type=True)  # -> StructureLines, StructureNodes
number_slider = Slider(0.018, range=0..0.1)
number_slider_2 = Slider(0.03, range=0..0.1)
curve = Curve(diagrid_structure.StructureLines)
construct_domain = ConstructDomain(DomainStart=expr("-x/2", number_slider_2), DomainEnd=expr("x/2", number_slider_2))
construct_domain_2 = ConstructDomain(DomainStart=expr("-x/2", number_slider), DomainEnd=expr("x/2", number_slider))
perp_frames = PerpFrames(Curve=curve, Count=10, Align=True)  # -> Frames, Parameters
rectangle = Rectangle(Plane=perp_frames.Frames, XSize=construct_domain, YSize=construct_domain_2, Radius=0)  # -> Rectangle, Length
loft_2 = Loft(
    Curves=rectangle.Rectangle,
    Options={Adjust=False, Closed=False, LoftEnds=0, LoftSimp=0, LoftType=0, Rebuild=10, Refit=0.01})
