# Grasshopper definition Pylon - Python.gh (Grasshopper 1.0.7)

mid_radius = Slider(10, range=0..10)
base_radius = Slider(20, range=0..100)
top_radius = Slider(25, range=0..100)
mid_point = Slider(20, range=0..100)
base_point = Slider(0, range=0..100)
top_point = Slider(40, range=0..100)
ghpython_script = GhPythonScript(x=base_point, y=mid_point, z=top_point, r1=base_radius, r2=mid_radius, r3=top_radius)  # -> out, surf; inputs x: Int32, y: Int32, z: Int32
# ---------- ghpython_script: Python ----------
import rhinoscriptsyntax as rs
import Rhino.Geometry as rg
import ghpythonlib.components as gh

centre_pt = [x,y,z]
radius = [r1,r2,r3]
circles = []

for i in range(3):
    point = rg.Point3d(0,0,centre_pt[i])
    cir = rg.Circle(point,radius[i])
    circ = rg.Circle.ToNurbsCurve(cir)
    circles.append(circ)

surf = rg.Brep.CreateFromLoft(circles, rg.Point3d.Unset, rg.Point3d.Unset, rg.LoftType.Normal, False)
# ---------- end ghpython_script ----------
divide_domain² = DivideDomain²(Domain=ghpython_script.surf, UCount=Slider(16, range=0..100), VCount=Slider(24, range=0..100))
isotrim = Isotrim(Surface=ghpython_script.surf, Domain=divide_domain²)
deconstruct_brep = DeconstructBrep(Brep=isotrim)  # -> Faces, Edges, Vertices
list_item = ListItem(List=deconstruct_brep.Vertices, Index=Slider(1, range=0..1), Wrap=True)
list_item_2 = ListItem(List=deconstruct_brep.Vertices, Index=Slider(0, range=0..100), Wrap=True)
list_item_3 = ListItem(List=deconstruct_brep.Vertices, Index=Slider(3, range=0..10), Wrap=True)
list_item_4 = ListItem(List=deconstruct_brep.Vertices, Index=Slider(2, range=0..10), Wrap=True)
line = Line(StartPoint=list_item_2, EndPoint=list_item_4)
line_2 = Line(StartPoint=list_item, EndPoint=list_item_3)
merge = Merge(Data1=line, Data2=line_2)
number_slider = Slider(0.018, range=0..0.1)
number_slider_2 = Slider(0.03, range=0..0.1)
perp_frames = PerpFrames(Curve=merge, Count=10, Align=True)  # -> Frames, Parameters
construct_domain = ConstructDomain(DomainStart=expr("-x/2", number_slider_2), DomainEnd=expr("x/2", number_slider_2))
construct_domain_2 = ConstructDomain(DomainStart=expr("-x/2", number_slider), DomainEnd=expr("x/2", number_slider))
rectangle = Rectangle(Plane=perp_frames.Frames, XSize=construct_domain, YSize=construct_domain_2, Radius=0)  # -> Rectangle, Length
loft = Loft(
    Curves=rectangle.Rectangle,
    Options={Adjust=False, Closed=False, LoftEnds=0, LoftSimp=0, LoftType=0, Rebuild=10, Refit=0.01})
