# Grasshopper definition Pylon- Parametric.gh (Grasshopper 1.0.7)

gene_pool = GenePool(Decimals=0, Maximum=40, Minimum=0, Value=[0, 20, 40])
gene_pool_2 = GenePool(Decimals=0, Maximum=50, Minimum=0, Value=[20, 10, 25])
construct_point = ConstructPoint(XCoordinate=0, YCoordinate=0, ZCoordinate=gene_pool)

# ---- group: Convert radius to Diameter
division = Division(A=gene_pool_2, B=2)

# ----
circle = Circle(Plane=construct_point, Radius=division)
loft = Loft(Curves=circle, Options={Adjust=False, Closed=False, LoftEnds=0, LoftSimp=0, LoftType=0, Rebuild=10, Refit=0.01})
surface = Surface(reparameterize(loft))

# ---- group: Datum Surface
srf = Surface(surface)

# ----
tolerance_for_similar_points = Slider(0.0001, range=0..0.0001)
radial_divisions = Slider(16, range=0..100)
vertical_divisions = Slider(8, range=0..100)
total_vertical_divisions_higher_more_acc = Slider(1000, range=0..10000)  # "Total vertical divisions (higher=more accuracy in control)"
dom = ConstructDomain(DomainStart=0, DomainEnd=1)
range = Range(Domain=dom, Steps=vertical_divisions)
graph = GraphMapper(
    range,
    x0=0,
    x1=1,
    y0=0,
    y1=1,
    container_name="Bezier",
    cpx=[0, 0.4036812186, 0.664681673, 1],
    cpy=[0, 0.3448893428, 0.6437191963, 1])
dom_2 = ConstructDomain(DomainStart=0, DomainEnd=total_vertical_divisions_higher_more_acc)
remap = RemapNumbers(Value=graph, Source=dom, Target=dom_2)  # -> Mapped, Clipped
round = Round(Number=remap.Mapped)  # -> Nearest, Floor, Ceiling

# ---- group: Define horizontal curves
sdivide = DivideSurface(Surface=srf, UCount=total_vertical_divisions_higher_more_acc, VCount=10)  # -> Points, Normals, Parameters
iso = IsoCurve(Surface=srf, UVPoint=sdivide.Parameters)  # -> UIsocurve, VIsocurve
flatten = FlattenTree(Tree=iso.VIsocurve, Path="{0}")
end = EndPoints(Curve=flatten)  # -> Start, End
cullpt = CullDuplicates(Points=end.Start, Tolerance=tolerance_for_similar_points, CullMode=1)  # -> Points, Indices, Valence
item = ListItem(List=flatten, Index=cullpt.Indices, Wrap=True)

# ---- group: Adjust seam of curve if outcome is flawed
item_2 = ListItem(List=item, Index=round.Nearest, Wrap=True)
seam = Seam(Curve=reparameterize(item_2), Seam=0.9)
divide = DivideCurve(Curve=seam, Count=radial_divisions, Kinks=False)  # -> simplify(Points), Tangents, Parameters

# ----
flip = FlipMatrix(Data=divide.Points)
flip_2 = FlipMatrix(Data=divide.Points)
tstat = TreeStatistics(Tree=divide.Points)  # -> Paths, Length, Count
tstat_2 = TreeStatistics(Tree=divide.Points)  # -> Paths, Length, Count

# ---- group: Define index and path location of points for interpolated curve
lng = ListLength(List=tstat.Length)
tstat_3 = TreeStatistics(Tree=flip)  # -> Paths, Length, Count
dpath = DeconstructPath(Branch=tstat_3.Paths)  # -> simplify(Indices)
lng_2 = ListLength(List=flip)
series = Series(Start=0, Step=1, Count=lng)
lng_3 = ListLength(List=tstat_3.Length)
series_2 = Series(Start=dpath, Step=1, Count=lng_2)
dup = DuplicateData(Data=series, Number=lng_3, Order=True)
python = GhPythonScript(x=series_2, y=lng_3)  # -> simplify(graft(a))
# ---------- python: Python ----------
if x>=y:
    a=x-y
else:
    a=x
__author__ = "Mirage"
__version__ = "2020.05.26"

import rhinoscriptsyntax as rs
import math

a= x % y;
# ---------- end python ----------
partition = PartitionList(List=dup, Size=simplify(lng))  # -> simplify(Chunks)
path = ConstructPath(Indices=python)

lng_4 = ListLength(List=tstat_2.Length)
tstat_4 = TreeStatistics(Tree=flip_2)  # -> Paths, Length, Count
dpath_2 = DeconstructPath(Branch=tstat_4.Paths)  # -> simplify(Indices)
lng_5 = ListLength(List=flip_2)
series_3 = Series(Start=0, Step=1, Count=lng_4)
lng_6 = ListLength(List=tstat_4.Length)
series_4 = Series(Start=dpath_2, Step=1, Count=lng_5)  # -> reverse(simplify(Series))
dup_2 = DuplicateData(Data=series_3, Number=lng_6, Order=True)
python_2 = GhPythonScript(x=series_4, y=lng_6)  # -> simplify(graft(a)); same code as python
partition_2 = PartitionList(List=dup_2, Size=simplify(lng_4))  # -> simplify(Chunks)
path_2 = ConstructPath(Indices=python_2)

# ---- group: Define index and path location of points for interpolated curve / Index of point
int = Integer(partition)

int_2 = Integer(partition_2)

# ---- group: Define index and path location of points for interpolated curve / Branch Path of point
trim = TrimTree(Tree=path, Depth=1)

trim_2 = TrimTree(Tree=path_2, Depth=1)

# ---- group: Direction 1 - Create interpolated curve on surface
item_3 = TreeItem(Tree=flip, Path=trim, Index=int, Wrap=True)
intcrv = Interpolate(Vertices=item_3, Degree=3, Periodic=False, KnotStyle=1)  # -> Curve, Length, Domain

# ---- group: Direction 2 - Create interpolated curve on surface
item_4 = TreeItem(Tree=flip_2, Path=trim_2, Index=int_2, Wrap=True)
intcrv_2 = Interpolate(Vertices=item_4, Degree=3, Periodic=False, KnotStyle=1)  # -> Curve, Length, Domain

# ----
crv = Curve(intcrv.Curve)
crv_2 = Curve(intcrv_2.Curve)
