# Grasshopper definition pylon - Vanilla GH.gh (Grasshopper 1.0.7)

gene_pool = GenePool(Decimals=0, Maximum=40, Minimum=0, Value=[0, 20, 40])
gene_pool_2 = GenePool(Decimals=0, Maximum=40, Minimum=0, Value=[20, 10, 25])
construct_point = ConstructPoint(XCoordinate=0, YCoordinate=0, ZCoordinate=gene_pool)
circle = Circle(Plane=construct_point, Radius=gene_pool_2)
loft = Loft(Curves=circle, Options={Adjust=False, Closed=False, LoftEnds=0, LoftSimp=0, LoftType=0, Rebuild=10, Refit=0.01})
surface = Surface(reparameterize(loft))
divide_domain² = DivideDomain²(Domain=surface, UCount=Slider(32, range=0..100), VCount=Slider(46, range=0..100))
isotrim = Isotrim(Surface=surface, Domain=divide_domain²)
deconstruct_brep = DeconstructBrep(Brep=isotrim)  # -> Faces, Edges, Vertices
panel = Panel(deconstruct_brep.Vertices)
list_item = ListItem(List=deconstruct_brep.Vertices, Index=Slider(1, range=0..1), Wrap=True)
list_item_2 = ListItem(List=deconstruct_brep.Vertices, Index=Slider(0, range=0..100), Wrap=True)
list_item_3 = ListItem(List=deconstruct_brep.Vertices, Index=Slider(3, range=0..10), Wrap=True)
list_item_4 = ListItem(List=deconstruct_brep.Vertices, Index=Slider(2, range=0..10), Wrap=True)
line = Line(StartPoint=list_item_2, EndPoint=list_item_4)
line_2 = Line(StartPoint=list_item, EndPoint=list_item_3)
merge = Merge(Data1=line, Data2=line_2)
number_slider = Slider(0.018, range=0..0.1)
number_slider_2 = Slider(0.03, range=0..0.1)
perp_frames = PerpFrames(Curve=merge, Count=10, Align=True)  # -> Frames, Parameters
construct_domain = ConstructDomain(DomainStart=expr("-x/2", number_slider_2), DomainEnd=expr("x/2", number_slider_2))
construct_domain_2 = ConstructDomain(DomainStart=expr("-x/2", number_slider), DomainEnd=expr("x/2", number_slider))
rectangle = Rectangle(Plane=perp_frames.Frames, XSize=construct_domain, YSize=construct_domain_2, Radius=0)  # -> Rectangle, Length
loft_2 = Loft(
    Curves=rectangle.Rectangle,
    Options={Adjust=False, Closed=False, LoftEnds=0, LoftSimp=0, LoftType=0, Rebuild=10, Refit=0.01})
