# Grasshopper definition pylon_.gh (Grasshopper 1.0.7)
# plug-ins: LunchBox

gene_pool = GenePool(Decimals=0, Maximum=40, Minimum=0, Value=[0, 20, 40])
gene_pool_2 = GenePool(Decimals=0, Maximum=40, Minimum=0, Value=[0, 20, 40])  # disabled
gene_pool_3 = GenePool(Decimals=0, Maximum=50, Minimum=0, Value=[20, 10, 25])
gene_pool_4 = GenePool(Decimals=0, Maximum=50, Minimum=0, Value=[20, 10, 25])  # disabled
construct_point = ConstructPoint(XCoordinate=0, YCoordinate=0, ZCoordinate=gene_pool)
construct_point_2 = ConstructPoint(XCoordinate=0, YCoordinate=0, ZCoordinate=gene_pool_2)  # disabled
circle = Circle(Plane=construct_point, Radius=gene_pool_3)
circle_2 = Circle(Plane=construct_point_2, Radius=gene_pool_4)  # disabled
loft = Loft(Curves=circle, Options={Adjust=False, Closed=False, LoftEnds=0, LoftSimp=0, LoftType=0, Rebuild=10, Refit=0.01})
number_slider = Slider(34, range=0..100)  # disabled
number_slider_2 = Slider(12, range=0..100)  # disabled
loft_2 = Loft(Curves=circle_2, Options={Adjust=False, Closed=False, LoftEnds=0, LoftSimp=0, LoftType=0, Rebuild=10, Refit=0.01})  # disabled
diagrid_structure = DiagridStructure(Surface=loft, UDivisions=Slider(16, range=0..100), VDivisions=Slider(22, range=0..100), Type=True)  # -> StructureLines, StructureNodes
diagrid_structure_2 = DiagridStructure(Surface=loft_2, UDivisions=number_slider_2, VDivisions=number_slider, Type=True)  # -> StructureLines, StructureNodes; disabled
number_slider_3 = Slider(0.5, range=0..1)  # disabled
perp_frames = PerpFrames(Curve=diagrid_structure.StructureLines, Count=10, Align=True)  # -> Frames, Parameters
curve = Curve(diagrid_structure_2.StructureLines)  # disabled
pipe = Pipe(Curve=curve, Radius=number_slider_3, Caps=0)  # disabled
unit_z = UnitZ(Factor=1)
rectangle = Rectangle(Plane=perp_frames.Frames, XSize=Slider(0.018, range=0..0.1), YSize=Slider(0.03, range=0..0.1), Radius=0)  # -> Rectangle, Length
rectangle_2 = Rectangle(Plane=unit_z, XSize=Slider(0.018, range=0..0.1), YSize=Slider(0.03, range=0..0.1), Radius=0)  # -> Rectangle, Length
list_item = ListItem(List=diagrid_structure.StructureLines, Index=Slider(23, range=0..100), Wrap=True)
area = Area(Geometry=rectangle.Rectangle)  # -> Area, Centroid
area_2 = Area(Geometry=rectangle_2.Rectangle, UseTasks=False)  # -> Area, Centroid
rectangle_3 = Rectangle(Plane=area.Centroid, XSize=Slider(0.018, range=0..0.1), YSize=Slider(0.03, range=0..0.1), Radius=0)  # -> Rectangle, Length
loft_3 = Loft(
    Curves=rectangle_3.Rectangle,
    Options={Adjust=False, Closed=False, LoftEnds=0, LoftSimp=0, LoftType=0, Rebuild=10, Refit=0.01})
